# Grasshopper definition hexagon.gh (Grasshopper 0.9.80)

number_slider = Slider(1.5, range=0..6)
number_slider_2 = Slider(6, range=0..10)
number_slider_3 = Slider(0.14, range=0..6)
number_slider_4 = Slider(2, range=0..6)
number_slider_5 = Slider(10, range=0..20)
number_slider_6 = Slider(2.5, range=0..20)
division = Division(A=number_slider_5, B=number_slider_4)
division_2 = Division(A=number_slider, B=Slider(2, range=0..6))
rectangle = Rectangle(Plane=PlaneXY(0, 0, 0), XSize=Slider(0.14, range=0..6), YSize=division, Radius=0)  # -> Rectangle, Length
rectangle_2 = Rectangle(Plane=PlaneXY(0, 0, 0), XSize=number_slider_6, YSize=number_slider_5, Radius=0)  # -> Rectangle, Length
rectangle_3 = Rectangle(Plane=PlaneXY(0, 0, 0), XSize=Slider(0.01, range=0..20), YSize=division_2, Radius=0)  # -> Rectangle, Length
polygon = Polygon(Plane=PlaneXY(0, 0, 0), Radius=number_slider, Segments=number_slider_2, FilletRadius=0)  # -> Polygon, Length
rectangle_4 = Rectangle(Plane=PlaneXY(0, 0, 0), XSize=number_slider_3, YSize=division_2, Radius=0)  # -> Rectangle, Length
division_3 = Division(A=number_slider_6, B=number_slider_4)
vector_xyz = VectorXYZ(XComponent=division_3, YComponent=Slider(0, range=0..6), ZComponent=0)  # -> Vector, Length
multiplication = Multiplication(A=number_slider_3, B=Slider(-0.5, range=-5..6))
subtraction = Subtraction(A=number_slider, B=division_2)
vector_xyz_2 = VectorXYZ(XComponent=multiplication, YComponent=subtraction, ZComponent=0)  # -> Vector, Length
move = Move(Geometry=rectangle.Rectangle, Motion=vector_xyz.Vector)  # -> Geometry, Transform
move_2 = Move(Geometry=rectangle_4.Rectangle, Motion=vector_xyz_2.Vector)  # -> Geometry, Transform
polar_array = PolarArray(Geometry=move_2.Geometry, Plane=PlaneXY(0, 0, 0), Count=number_slider_2, Angle=6.283185307)  # -> Geometry, Transform
