# Grasshopper definition egg.gh (Grasshopper 0.9.80)

geometry = Geometry(<curve referenced from the Rhino model>)
geometry_2 = Geometry(<curve referenced from the Rhino model>)
region_difference = RegionDifference(CurvesA=geometry, CurvesB=geometry_2)
geometry_3 = Geometry(<curve referenced from the Rhino model>)
geometry_4 = Geometry(<curve referenced from the Rhino model>)
geometry_5 = Geometry(<curve referenced from the Rhino model>)
geometry_6 = Geometry(<curve referenced from the Rhino model>)
geometry_7 = Geometry(<curve referenced from the Rhino model>)
geometry_8 = Geometry(<curve referenced from the Rhino model>)
geometry_9 = Geometry(<curve referenced from the Rhino model>)
point = Point(Point(0, 0.1, 0))
point_2 = Point(Point(0, 0, 0))
vector_2pt = Vector2Pt(PointA=point_2, PointB=point, Unitize=False)  # -> Vector, Length
surface_split = SurfaceSplit(Surface=geometry_3, Curves=geometry_7)
extrude = Extrude(Base=region_difference, Direction=vector_2pt.Vector)
egg = Slider(15, range=0..30)
surface_split_2 = SurfaceSplit(Surface=surface_split, Curves=geometry_4)
cap_holes = CapHoles(Brep=extrude)
surface_split_3 = SurfaceSplit(Surface=surface_split_2, Curves=geometry_5)
polar_array = PolarArray(Geometry=cap_holes, Plane=PlaneXY(0, 0, 0), Count=egg, Angle=6.283185307)  # -> Geometry, Transform
point_3 = Point(Point(0, 0, 0.05))
surface_split_4 = SurfaceSplit(Surface=surface_split_3, Curves=geometry_8)
brep = Brep(<brep referenced from the Rhino model>)
vector_2pt_2 = Vector2Pt(PointA=point_2, PointB=point_3, Unitize=False)  # -> Vector, Length
surface_split_5 = SurfaceSplit(Surface=surface_split_4, Curves=geometry_9)
solid_difference = SolidDifference(BrepsA=polar_array.Geometry, BrepsB=brep)
brep_2 = Brep(<brep referenced from the Rhino model>)
surface_split_6 = SurfaceSplit(Surface=surface_split_5, Curves=geometry_6)
extrude_2 = Extrude(Base=surface_split_6, Direction=vector_2pt_2.Vector)
solid_difference_2 = SolidDifference(BrepsA=solid_difference, BrepsB=brep_2)
cap_holes_2 = CapHoles(Brep=extrude_2)
